vi "Filter Systems by Package.gviweb"   [G Web Development Software 21.0.0]
inputs:
  "configuration in": "Configuration.gtype"
  "package": string
  "error in": error
outputs:
  "systems": T1[]
  "error out": error
  "configuration out": "Configuration.gtype"
panel indicators:
  "id": string[]
  "body": string
  "headers": string
  "error out_2": error
types:
  "Client Handle.gtype" = u32
  "Workspace.gtype" = cluster{"id": string, "name": string, "archived?": bool, "default?": bool}
  "Configuration.gtype" = cluster{"Server URL": string, "Session": "Client Handle.gtype", "Raw Session Queue": Queue<"Client Handle.gtype">, "Workspace": "Workspace.gtype"}
  T1 = cluster{"id": string, "alias": string, "state": string}
uses:
  NI::HTTP::POST Buffer.gvi
diagram:
  Property Node(instance in=$"configuration in") -> ("Session"=w1, "Server URL"=w2)
  Concatenate Strings(w2, "/nisysmgmt/v1/query-systems") -> w3
  w4 = "\\\")\",\n  \"projection\": \"new(id,alias,connected.data.state)\"\n}"
  Concatenate Strings("{  \n  \"filter\": \"packages.data.Keys.Contains(\\\"", $package, w4) -> w5
  call "POST Buffer.gvi"(client handle=w1, url=w3, buffer=w5, error in=$"error in") -> (headers=w6, body=w7, error out=w8)
  Unflatten From Json(JSON string=w7, default null elements=TRUE, error in (no error)=w8, type and defaults=cluster{"data": T1[], "count": i32} {all zero or empty}) -> (error out=w9, value=w10)
  Property Node(instance in=w10) -> ("data"=w11)
  $systems <- w11
  $"configuration out" <- $"configuration in"
  $body <- w7
  for {
    w12 = each element of w11
    Property Node(instance in=w12) -> ("id"=w14)
    append w14 to w13
  }
  $id <- w13
  $headers <- w6
  $"error out_2" <- w8
  $"error out" <- w9
