vi "Get Results.gviweb"   [LabVIEW NXG 3.1.0]
inputs:
  "configuration": "Configuration.gtype"
  "jid": string
  "timeout (s)": i32 = 10
  "error in": error
outputs:
  "error out": error
  "state": string
  "body": string
  "file contents": string
panel indicators:
  "headers": string
types:
  "Client Handle.gtype" = u32
  "Configuration.gtype" = cluster{"Server URL": string, "Session": "Client Handle.gtype"}
  T1 = cluster{"state": string, "result": cluster{"return": string[]}}
uses:
  NI::HTTP::GET.gvi
diagram:
  Property Node(instance in=$configuration) -> ("Session"=w1, "Server URL"=w2)
  Concatenate Strings(w2, "/nisysmgmt/v1/jobs", "?jid=", $jid) -> w3
  for (N = $"timeout (s)") {
    Wait Until Next Multiple(multiple to wait=1000)
    call "GET.gvi"(client handle=w1, url=w3, error in=$"error in") -> (headers=w4, body=w5, error out=w6)
    Unflatten From JSON(JSON string=w5, type and defaults=cluster{"state": string}[] []) -> (value=w7)
    Array Index(array=w7) -> (out0[_]=w8)
    Property Node(instance in=w8) -> ("state"=w9)
    Is Equal(x=w9, y="SUCCEEDED") -> w10
    Is Equal(x=w9, y="FAILED") -> w11
    Logical Or(w10, w11) -> w12
    stop if w12
  }
  $headers <- w4
  $body <- w5
  Unflatten From JSON(JSON string=w5, type and defaults=T1[] []) -> (value=w13)
  Array Index(array=w13) -> (out0[_]=w14)
  Property Node(instance in=w14) -> ("state"=w15, "result:return"=w16)
  $state <- w15
  $"error out" <- w6
  Array Index(array=w16) -> (out0[_]=w17)
  $"file contents" <- w17
