vi "Main.gviweb"   [G Web Development Software 21.0.0]
panel controls:
  "System": i32
  "File": string = "/home/lvuser/README_File_Paths.txt"
  "Read File": bool
panel indicators:
  "System Status": string
  "File Contents": string
  "jid": string
  "state": string
uses:
  NI::Skyline::Configuration::Open Configuration Auto.gvi
  NI::Skyline::Configuration::Open Configuration.gvi
  WebApp::Filter Systems by Package.gviweb
  WebApp::Get System Info.gviweb
  WebApp::Read File.gviweb
  WebApp::Get Results.gviweb
diagram:
  w1 = FALSE  # Development
  case (w1) {
    frame False, Default {
      call "Open Configuration Auto.gvi"() -> (configuration=w2, error out=w3)
    }
    frame True {
      w4 = "http://localhost"  # Server
      call "Open Configuration.gvi"(server url=w4, username="admin", password="admin") -> (configuration=w2, error out=w3)
    }
  }
  call "Filter Systems by Package.gviweb"(configuration in=w2, package="salt-minion", error in=w3) -> (configuration out=w5, systems=w6, error out=w7)
  for {
    w8 = each element of w6
    Property Node(instance in=w8) -> ("alias"=w10)
    append w10 to w9
  }
  Property Node(instance in=reference to "System", "Items"=w9, "Value"=0, error in=w7) -> (error out=w11)
  while {
    Property Node(instance in=reference to "System", error in=w11) -> ("Items"=w12)
    Array Index(array=w12) -> (out0[$System]=w13)
    call "Get System Info.gviweb"(configuration in=w5, System=w13) -> (State=w14, configuration out=w15, ID=w16)
    event (timeout = 500) {
      on "Timeout" {
        case (w14) {
          frame "Disconnected", Default { }
          frame "Connected" { }
        }
      }
      on "System" Value changed { }
      on "Read File" Value changed {
        call "Read File.gviweb"(configuration=w15, minion ID=w16, file=$File) -> (configuration out=w17, jid=w18)
        call "Get Results.gviweb"(configuration=w17, jid=w18) -> (state=w19, file contents=w20)
        $state <- w19
        $"File Contents" <- w20
        $jid <- w18
      }
    }
    $"System Status" <- w14
    stop if FALSE
  }
