vi "Read File.gviweb"   [LabVIEW NXG 3.1.0]
inputs:
  "configuration": "Configuration.gtype"
  "minion ID": string = "NI_PXIe-8133_Embedded_Controller--MAC-00-80-2F-12-7F-31"
  "file": string = "Computer Motherboard Tests.seq"
  "timeout": u32 = 600
  "error in": error
outputs:
  "error out": error
  "POST Request": string
  "body": string
  "jid": string
  "configuration out": "Configuration.gtype"
panel indicators:
  "headers": string
types:
  "Client Handle.gtype" = u32
  "Configuration.gtype" = cluster{"Server URL": string, "Session": "Client Handle.gtype"}
uses:
  WebApp::Encode.gviweb
  NI::HTTP::POST Buffer.gvi
diagram:
  $"configuration out" <- $configuration
  Property Node(instance in=$configuration) -> ("Session"=w1, "Server URL"=w2)
  Concatenate Strings(w2, "/nisysmgmt/v1/jobs") -> w3
  w4 = "\"\n   ],\n   \"metadata\":{  \n      \"queued\":true,\n      \"timeout\":"
  Format Into String(formatString="%d", $timeout) -> w5
  call "Encode.gviweb"(string input=$file) -> (string output=w6)
  Concatenate Strings("{  \n   \"tgt\":[  \n      \"", $"minion ID", w4, w5, "\n   },\n   \"fun\":[\"file.read\"],\n   \"arg\":[[\"", w6, "\"", "   ]]\n}") -> w7
  call "POST Buffer.gvi"(client handle=w1, url=w3, buffer=w7, error in=$"error in") -> (headers=w8, body=w9, error out=w10)
  $headers <- w8
  w11 = cluster{"jid": string} {all zero or empty}  # Cluster Constant
  Unflatten From JSON(JSON string=w9, type and defaults=w11) -> (value=w12)
  Property Node(instance in=w12) -> ("jid"=w13)
  $jid <- w13
  $body <- w9
  $"error out" <- w10
  $"POST Request" <- w7
